# Grasshopper definition points.gh (Grasshopper 1.0.7)

酒店 = FilePath("/Users/zehpmei/Documents/01PersonalFiles/23AECOM实习期间的玩耍/200623baidumap/酒店.csv")
商业 = FilePath("/Users/zehpmei/Documents/01PersonalFiles/23AECOM实习期间的玩耍/200623baidumap/商业.csv")
学校 = FilePath("/Users/zehpmei/Documents/01PersonalFiles/23AECOM实习期间的玩耍/200623baidumap/学校.csv")
文化 = FilePath("/Users/zehpmei/Documents/01PersonalFiles/23AECOM实习期间的玩耍/200623baidumap/文化.csv")
file = ReadFile(File=商业, PerLineParse=True)
file_2 = ReadFile(File=酒店, PerLineParse=True)
file_3 = ReadFile(File=学校, PerLineParse=True)
file_4 = ReadFile(File=文化, PerLineParse=True)
cull_i = CullIndex(List=file, Indices="0", Wrap=True)
cull_i_2 = CullIndex(List=file_2, Indices="0", Wrap=True)
cull_i_3 = CullIndex(List=file_3, Indices="0", Wrap=True)
cull_i_4 = CullIndex(List=file_4, Indices="0", Wrap=True)
split = TextSplit(Text=cull_i, Separators=",")
split_2 = TextSplit(Text=cull_i_2, Separators=",")
split_3 = TextSplit(Text=cull_i_3, Separators=",")
split_4 = TextSplit(Text=cull_i_4, Separators=",")
cull_i_5 = CullIndex(List=split, Indices="3", Wrap=True)
cull_i_6 = CullIndex(List=split_2, Indices="3", Wrap=True)
cull_i_7 = CullIndex(List=split_3, Indices="3", Wrap=True)
cull_i_8 = CullIndex(List=split_4, Indices="3", Wrap=True)
item = ListItem(List=cull_i_5, Index="1", Wrap=True)
item_2 = ListItem(List=cull_i_6, Index="1", Wrap=True)
item_3 = ListItem(List=cull_i_6, Index="0", Wrap=True)
item_4 = ListItem(List=cull_i_5, Index="2", Wrap=True)
item_5 = ListItem(List=cull_i_6, Index="2", Wrap=True)
item_6 = ListItem(List=cull_i_5, Index="0", Wrap=True)
item_7 = ListItem(List=cull_i_7, Index="1", Wrap=True)
item_8 = ListItem(List=cull_i_7, Index="2", Wrap=True)
item_9 = ListItem(List=cull_i_8, Index="0", Wrap=True)
item_10 = ListItem(List=cull_i_7, Index="0", Wrap=True)
item_11 = ListItem(List=cull_i_8, Index="1", Wrap=True)
item_12 = ListItem(List=cull_i_8, Index="2", Wrap=True)
pt = ConstructPoint(XCoordinate=item, YCoordinate=item_4, ZCoordinate="0")
pt_2 = ConstructPoint(XCoordinate=item_2, YCoordinate=item_5, ZCoordinate="0")
pt_3 = ConstructPoint(XCoordinate=item_7, YCoordinate=item_8, ZCoordinate="0")
pt_4 = ConstructPoint(XCoordinate=item_11, YCoordinate=item_12, ZCoordinate="0")
item_13 = ListItem(List=flatten(pt_3), Index=Slider(7, range=0..10), Wrap=True)
item_14 = ListItem(List=flatten(pt), Index=Slider(3, range=0..10), Wrap=True)
tag = TextTag(Location=pt_2, Text=item_3)
tag_2 = TextTag(Location=pt, Text=item_6)
tag_3 = TextTag(Location=pt_4, Text=item_9)
tag_4 = TextTag(Location=pt_3, Text=item_10)
pt_5 = Point(pt_3)
pt_6 = Point(pt)
pt_7 = Point(pt_4)
pt_8 = Point(pt_2)
cir = Circle(Plane=pt_5, Radius="0.0003")
cir_2 = Circle(Plane=pt_6, Radius="0.0003")
cir_3 = Circle(Plane=pt_7, Radius="0.0003")
cir_4 = Circle(Plane=pt_8, Radius="0.0003")
